# Grasshopper definition Triangulated_dome.gh (Grasshopper 1.0.7)
# plug-ins: Weaverbird

number_slider = Slider(250, range=0..1000)
number_slider_2 = Slider(110, range=0..110)
pt = ConstructPoint(XCoordinate=Slider(21, range=0..100), YCoordinate=0, ZCoordinate=0)
msphereex = MeshSphereEx(Base=PlaneXY(0, 0, 0), Radius=number_slider, Count=Slider(8, range=0..10))
msphereex_2 = MeshSphereEx(Base=pt, Radius=Slider(8, range=0..110), Count=Slider(6, range=0..10))
msplit = MeshSplit(Mesh=flatten(msphereex), Splitters=flatten(msphereex_2))  # -> flatten(Result)
multiplication = Multiplication(A=number_slider, B=2)
area = Area(Geometry=msphereex)  # -> Area, Centroid
box = CenterBox(Base=area.Centroid, X=multiplication, Y=multiplication, Z=Slider(0.01, range=0..0.01))
item = ListItem(List=msplit, Index=Slider(2, range=0..2), Wrap=True)
msplit_2 = MeshSplit(Mesh=item, Splitters=box)
item_2 = ListItem(List=msplit_2, Index=0, Wrap=True)
msplit_3 = MeshSplit(Mesh=flatten(item_2), Splitters=msphereex_2)
qrmesh = QuadRemesh(Mesh=item_2, Settings=Slider(12, range=0..100))
triangulate = GetNumber(Slider(2, range=0..2.5), AtLeast=1, AtMost=1, Maximum=1.797693135e+308, Minimum=-1.797693135e+308, TreeAccess=False)
wbstellate = WeaverbirdsStellateCumulation(MeshPolylines=qrmesh, Distance=triangulate)
subdivide_triangles = GetNumber(Slider(2, range=0..2.5), AtLeast=1, AtMost=1, Maximum=1.797693135e+308, Minimum=-1.797693135e+308, TreeAccess=False)
wbstellate_2 = WeaverbirdsStellateCumulation(MeshPolylines=wbstellate, Distance=subdivide_triangles)
inflate_triangles = GetNumber(Slider(1, range=0..1), AtLeast=1, AtMost=1, Maximum=1.797693135e+308, Minimum=-1.797693135e+308, TreeAccess=False)
panel_openings = GetInteger(Slider(38, range=15..50), AtLeast=1, AtMost=1, Maximum=2147483647, Minimum=-2147483648, TreeAccess=False)
wbstellate_3 = WeaverbirdsStellateCumulation(MeshPolylines=wbstellate_2, Distance=inflate_triangles)
dom = ConstructDomain(DomainStart=Slider(0, range=0..1), DomainEnd=panel_openings)
bnd = Bounds(Numbers=wbstellate_3)
remap = RemapNumbers(Value=wbstellate_3, Source=bnd, Target=dom)  # -> Mapped, Clipped
gradient = Gradient(LowerLimit=remap.Mapped, UpperLimit=wbstellate_3, Parameter=bnd, stops=[0.217: RGB(199, 21, 133), 1: RGB(255, 130, 160)])
wbframe = WeaverbirdsPictureFrame(MeshPolylines=wbstellate_3, Distance=remap.Mapped, InsetType=Slider(0, range=0..1))
mcol = MeshColours(Mesh=wbframe, Colours=gradient)
context_bake = ContextBake(Geometry=mcol)
